# Grasshopper definition main.ghx (Grasshopper 1.0.8)

xy = XYPlane(Origin=Point(0, 0, 0))
rad = Radians(Degrees=Slider(20, range=0..100))
rad_2 = Radians(Degrees=Slider(20, range=0..100))
X = UnitX(Factor=1)
Y = UnitY(Factor=1)
rot3d = Rotate3D(Geometry=xy, Angle=rad, Center=Point(0, 0, 0), Axis=X)  # -> Geometry, Transform
rot3d_2 = Rotate3D(Geometry=rot3d.Geometry, Angle=rad_2, Center=Point(0, 0, 0), Axis=Y)  # -> Geometry, Transform
geo = Geometry(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)
number_slider = Slider(16, range=5..30)
semantictest_movenick = BoundingBox(Content=geo, Plane=rot3d_2.Geometry)  # -> Box, Box_2
volume = Volume(Geometry=semantictest_movenick.Box)  # -> Volume, Centroid
scale = Scale(Geometry=semantictest_movenick.Box, Center=volume.Centroid, Factor=Slider(0.95, range=0..1))  # -> Geometry, Transform
debrep = DeconstructBrep(Brep=scale.Geometry)  # -> Faces, Edges, Vertices
# Edges along Plane.X and Plane.Y
item = ListItem(List=debrep.Edges, Index=0, Wrap=True)  # -> Item, Item1
deplane = DeconstructPlane(Plane=rot3d_2.Geometry)  # -> Origin, XAxis, YAxis, ZAxis
pframes = PerpFrames(Curve=item.Item, Count=number_slider, Align=True)  # -> Frames, Parameters
pframes_2 = PerpFrames(Curve=item.Item1, Count=number_slider, Align=True)  # -> Frames, Parameters
sec = BrepPlane(Brep=geo, Plane=pframes.Frames)  # -> Curves, Points
# Section along Edges[0]
boundary = BoundarySurfaces(Edges=sec.Curves)  # -> simplify(Surfaces)
sec_2 = BrepPlane(Brep=geo, Plane=pframes_2.Frames)  # -> Curves, Points
# Section along Edges[1]
boundary_2 = BoundarySurfaces(Edges=sec_2.Curves)  # -> simplify(Surfaces)
debrep_2 = DeconstructBrep(Brep=semantictest_movenick.Box)  # -> Faces, Edges, Vertices
item_2 = ListItem(List=debrep_2.Edges, Index=Slider(8, range=0..10), Wrap=True)
len = Length(Curve=item_2)
graft = GraftTree(Tree=pframes.Frames, IncludeEmptyLists=True, IncludeNullItems=True)  # -> simplify(Tree)
graft_2 = GraftTree(Tree=pframes_2.Frames, IncludeEmptyLists=True, IncludeNullItems=True)  # -> simplify(Tree)
graft_3 = GraftTree(Tree=boundary, IncludeEmptyLists=True, IncludeNullItems=True)
flatten = FlattenTree(Tree=boundary, Path="{0}")
graft_4 = GraftTree(Tree=boundary_2, IncludeEmptyLists=True, IncludeNullItems=True)
flatten_2 = FlattenTree(Tree=boundary_2, Path="{0}")
c_script = CSharpScript(x=graft, y=graft_3)  # -> out, a; inputs x: tree, y: tree
# ---------- c_script: C# ----------
// Grasshopper Script Instance
#region Usings
using System;
using System.Linq;
using System.Collections;
using System.Collections.Generic;
using System.Drawing;

using Rhino;
using Rhino.Geometry;

using Grasshopper;
using Grasshopper.Kernel;
using Grasshopper.Kernel.Data;
using Grasshopper.Kernel.Types;
#endregion

public class Script_Instance : GH_ScriptInstance
{
    #region Notes
    /* 
      Members:
        RhinoDoc RhinoDocument
        GH_Document GrasshopperDocument
        IGH_Component Component
        int Iteration

      Methods (Virtual & overridable):
        Print(string text)
        Print(string format, params object[] args)
        Reflect(object obj)
        Reflect(object obj, string method_name)
    */
    #endregion

    private void RunScript(DataTree<object> x, DataTree<object> y, ref object a)
    {
        var xMap = new Dictionary<int, object>();
        foreach (GH_Path p in x.Paths){
            var branch = x.Branch(p);
            if (branch.Count > 0){
                xMap[p.Indices[0]] = branch[0];
            }
        }

        var result = new DataTree<object>();
        foreach (GH_Path p in y.Paths){
            int n = p.Indices[0];
            if (xMap.TryGetValue(n, out object item)){
                result.Add(item, p);
            }
        }

        a = result;
    }
}
# ---------- end c_script ----------
c_script_2 = CSharpScript(x=graft_2, y=graft_4)  # -> out, a; inputs x: tree, y: tree; same code as c_script
material_thickness = Slider(3.1, range=0..10)
bbx = BrepBrep(BrepA=graft_4, BrepB=flatten)  # -> Curves, Points
pshift = ShiftPaths(Data=bbx.Curves, Offset=-1)
midpt = CurveMiddle(Curve=pshift)
bbx_2 = BrepBrep(BrepA=graft_3, BrepB=flatten_2)  # -> Curves, Points
pshift_2 = ShiftPaths(Data=bbx_2.Curves, Offset=-1)
midpt_2 = CurveMiddle(Curve=pshift_2)
line = LineSDL(Start=midpt, Direction=expr("-x", deplane.ZAxis), Length=len)
line_2 = LineSDL(Start=midpt_2, Direction=deplane.ZAxis, Length=len)
deplane_2 = DeconstructPlane(Plane=rot3d_2.Geometry)  # -> Origin, XAxis, YAxis, ZAxis
line_3 = LineSDL(Start=midpt_2, Direction=deplane.ZAxis, Length=len)
deplane_3 = DeconstructPlane(Plane=rot3d_2.Geometry)  # -> Origin, XAxis, YAxis, ZAxis
pipe = Pipe(Curve=line, Radius=expr("x/2", material_thickness), Caps=1, FitRail=False)
pipe_2 = Pipe(Curve=line_2, Radius=expr("x/2", material_thickness), Caps=1, FitRail=False)
pshift_3 = ShiftPaths(Data=pipe_2, Offset=-1)
sec_3 = BrepPlane(Brep=pshift_3, Plane=c_script.a)  # -> Curves, Points
pshift_4 = ShiftPaths(Data=sec_3.Curves, Offset=-1)
rdiff = RegionDifference(CurvesA=graft_3, CurvesB=pshift_4)
area = Area(Geometry=rdiff)  # -> Area, Centroid
pl = ConstructPlane(Origin=area.Centroid, XAxis=deplane_2.ZAxis, YAxis=deplane_2.YAxis)
pipe_3 = Pipe(Curve=line_3, Radius=expr("x/2", material_thickness), Caps=1, FitRail=False)
pshift_5 = ShiftPaths(Data=pipe_3, Offset=-1)
sec_4 = BrepPlane(Brep=pshift_5, Plane=c_script.a)  # -> Curves, Points
pshift_6 = ShiftPaths(Data=sec_4.Curves, Offset=-1)
rdiff_2 = RegionDifference(CurvesA=graft_3, CurvesB=pshift_6)
area_2 = Area(Geometry=rdiff_2)  # -> Area, Centroid
pl_2 = ConstructPlane(Origin=area_2.Centroid, XAxis=deplane_3.ZAxis, YAxis=deplane_3.YAxis)
tstat = TreeStatistics(Tree=pshift_4)  # -> Paths, Length, Count
tstat_2 = TreeStatistics(Tree=pshift_6)  # -> Paths, Length, Count
lng = ListLength(List=tstat.Paths)
dpath = DeconstructPath(Branch=tstat.Paths)
lng_2 = ListLength(List=tstat_2.Paths)
dpath_2 = DeconstructPath(Branch=tstat_2.Paths)
item_3 = ListItem(List=dpath, Index=0, Wrap=True)  # -> Item, Item1
item_4 = ListItem(List=dpath_2, Index=0, Wrap=True)  # -> Item, Item1
concat = Concatenate(FragmentA="X", FragmentB=item_3.Item, FragmentC="-", FragmentD=item_3.Item1)
series = Series(Start=0, Step=Slider(200, range=0..1000), Count=lng)
pt = ConstructPoint(XCoordinate=series, YCoordinate=0, ZCoordinate=0)
xy_2 = XYPlane(Origin=pt)
concat_2 = Concatenate(FragmentA="X", FragmentB=item_4.Item, FragmentC="-", FragmentD=item_4.Item1)
series_2 = Series(Start=0, Step=Slider(200, range=0..1000), Count=lng_2)
pt_2 = ConstructPoint(XCoordinate=series_2, YCoordinate=0, ZCoordinate=0)
xy_3 = XYPlane(Origin=pt_2)
line_4 = LineSDL(Start=midpt, Direction=expr("-x", deplane.ZAxis), Length=len)
deplane_4 = DeconstructPlane(Plane=rot3d_2.Geometry)  # -> Origin, XAxis, YAxis, ZAxis
tag = TextTag3D(Location=pl, Text=concat, Size=Slider(9, range=0..100), Colour=ColourSwatch(SwatchColor=RGB(255, 0, 0)), Justification=7)
c_script_3 = CSharpScript(
    textLine=concat,
    frame=graft(xy_2),
    fontName="SLF_RHN Architect",
    textHeight=Slider(7, range=0..100),
    spacing=Slider(0, range=0..100),
    horizontalAlignment=Slider(2, range=1..3),
    verticalAlignment=Slider(2, range=1..3),
    bold=Toggle(False),
    singleStrokeFont=Toggle(False))  # -> out, a, b; inputs textLine: String, frame: Plane, fontName: String, textHeight: Double, spacing: Double, horizontalAlignment: Int32, verticalAlignment: Int32, bold: Boolean, singleStrokeFont: Boolean
# ---------- c_script_3: C# ----------
// Grasshopper Script Instance
#region Usings
using System;
using System.Linq;
using System.Collections;
using System.Collections.Generic;


using Rhino;
using Rhino.Geometry;
using Rhino.DocObjects;

using Grasshopper;
using Grasshopper.Kernel;
using Grasshopper.Kernel.Data;
using Grasshopper.Kernel.Types;
#endregion

public class Script_Instance : GH_ScriptInstance
{
    #region Notes
    /* 
      Members:
        RhinoDoc RhinoDocument
        GH_Document GrasshopperDocument
        IGH_Component Component
        int Iteration

      Methods (Virtual & overridable):
        Print(string text)
        Print(string format, params object[] args)
        Reflect(object obj)
        Reflect(object obj, string method_name)
    */
    #endregion

    private void RunScript(
		string textLine,
		Plane frame,
		string fontName,
		double textHeight,
		double spacing,
		int horizontalAlignment,
		int verticalAlignment,
		bool bold,
		bool singleStrokeFont,
		ref object a,
		ref object b)
    {
        DimensionStyle dimStyle = new DimensionStyle();
        Font thisFont = new Font(fontName);
        if(bold){
        thisFont = new Font(fontName, Font.FontWeight.Bold, Font.FontStyle.Upright, false, false);
        }
        else{
        thisFont = new Font(fontName, Font.FontWeight.Normal, Font.FontStyle.Upright, false, false);
        }
        dimStyle.Font = thisFont;
        dimStyle.TextHeight = textHeight;
        int halign = horizontalAlignment;
        int valign = verticalAlignment;

        switch(halign){
        case 1:
            dimStyle.TextHorizontalAlignment = TextHorizontalAlignment.Left;
            break;
        case 2:
            dimStyle.TextHorizontalAlignment = TextHorizontalAlignment.Center;
            break;
        case 3:
            dimStyle.TextHorizontalAlignment = TextHorizontalAlignment.Right;
            break;
        default:
            dimStyle.TextHorizontalAlignment = TextHorizontalAlignment.Center;
            break;
        }
        switch(valign){
        case 1:
            dimStyle.TextVerticalAlignment = TextVerticalAlignment.Bottom;
            break;
        case 2:
            dimStyle.TextVerticalAlignment = TextVerticalAlignment.Middle;
            break;
        case 3:
            dimStyle.TextVerticalAlignment = TextVerticalAlignment.Top;
            break;
        default:
            dimStyle.TextVerticalAlignment = TextVerticalAlignment.Middle;
            break;
        }


        TextEntity tEntity = Rhino.Geometry.TextEntity.Create(textLine, frame, dimStyle, false, textHeight, 0);
        Brep[] srf = tEntity.CreateSurfaces(dimStyle, 0, spacing);
        Curve[] crv = tEntity.CreateCurves(dimStyle, singleStrokeFont, 0, spacing);
        a = srf;
        b = crv;
    }
}
# ---------- end c_script_3 ----------
deplane_5 = DeconstructPlane(Plane=rot3d_2.Geometry)  # -> Origin, XAxis, YAxis, ZAxis
tag_2 = TextTag3D(
    Location=pl_2,
    Text=concat_2,
    Size=Slider(9, range=0..100),
    Colour=ColourSwatch(SwatchColor=RGB(255, 0, 0)),
    Justification=7)
c_script_4 = CSharpScript(
    textLine=concat_2,
    frame=graft(xy_3),
    fontName="SLF_RHN Architect",
    textHeight=Slider(7, range=0..100),
    spacing=Slider(0, range=0..100),
    horizontalAlignment=Slider(2, range=1..3),
    verticalAlignment=Slider(2, range=1..3),
    bold=Toggle(False),
    singleStrokeFont=Toggle(False))  # -> out, a, b; inputs textLine: String, frame: Plane, fontName: String, textHeight: Double, spacing: Double, horizontalAlignment: Int32, verticalAlignment: Int32, bold: Boolean, singleStrokeFont: Boolean; same code as c_script_3
pipe_4 = Pipe(Curve=line_4, Radius=expr("x/2", material_thickness), Caps=1, FitRail=False)
pshift_7 = ShiftPaths(Data=pipe_4, Offset=-1)
sec_5 = BrepPlane(Brep=pshift_7, Plane=c_script_2.a)  # -> Curves, Points
pshift_8 = ShiftPaths(Data=sec_5.Curves, Offset=-1)
rdiff_3 = RegionDifference(CurvesA=graft_4, CurvesB=pshift_8)
area_3 = Area(Geometry=rdiff_3)  # -> Area, Centroid
pl_3 = ConstructPlane(Origin=area_3.Centroid, XAxis=deplane_4.ZAxis, YAxis=deplane_4.XAxis)
orient = Orient(Geometry=rdiff, Source=pl, Target=graft(xy_2))  # -> Geometry, Transform
pshift_9 = ShiftPaths(Data=pipe, Offset=-1)
sec_6 = BrepPlane(Brep=pshift_9, Plane=c_script_2.a)  # -> Curves, Points
pshift_10 = ShiftPaths(Data=sec_6.Curves, Offset=-1)
rdiff_4 = RegionDifference(CurvesA=graft_4, CurvesB=pshift_10)
area_4 = Area(Geometry=rdiff_4)  # -> Area, Centroid
pl_4 = ConstructPlane(Origin=area_4.Centroid, XAxis=deplane_5.ZAxis, YAxis=deplane_5.XAxis)
orient_2 = Orient(Geometry=rdiff_2, Source=pl_2, Target=graft(xy_3))  # -> Geometry, Transform
tstat_3 = TreeStatistics(Tree=pshift_8)  # -> Paths, Length, Count
tstat_4 = TreeStatistics(Tree=pshift_10)  # -> Paths, Length, Count
tstat_5 = TreeStatistics(Tree=c_script_3.b)  # -> Paths, Length, Count
replace = ReplacePaths(Data=c_script_3.b, Search=tstat_5.Paths, Replace=tstat.Paths)
group = Group(Geometry=replace)
lng_3 = ListLength(List=tstat_3.Paths)
tstat_6 = TreeStatistics(Tree=c_script_4.b)  # -> Paths, Length, Count
replace_2 = ReplacePaths(Data=c_script_4.b, Search=tstat_6.Paths, Replace=tstat_2.Paths)
group_2 = Group(Geometry=replace_2)
dpath_3 = DeconstructPath(Branch=tstat_3.Paths)
lng_4 = ListLength(List=tstat_4.Paths)
dpath_4 = DeconstructPath(Branch=tstat_4.Paths)
item_5 = ListItem(List=dpath_3, Index=0, Wrap=True)  # -> Item, Item1
item_6 = ListItem(List=dpath_4, Index=0, Wrap=True)  # -> Item, Item1
c_script_5 = CSharpScript()  # -> out, a
# ---------- c_script_5: C# ----------
// Grasshopper Script Instance
#region Usings
using System;
using System.Linq;
using System.Collections;
using System.Collections.Generic;
using System.Drawing;
using System.Drawing.Text;

using Rhino;
using Rhino.Geometry;

using Grasshopper;
using Grasshopper.Kernel;
using Grasshopper.Kernel.Data;
using Grasshopper.Kernel.Types;
#endregion

public class Script_Instance : GH_ScriptInstance
{
    #region Notes
    /* 
      Members:
        RhinoDoc RhinoDocument
        GH_Document GrasshopperDocument
        IGH_Component Component
        int Iteration

      Methods (Virtual & overridable):
        Print(string text)
        Print(string format, params object[] args)
        Reflect(object obj)
        Reflect(object obj, string method_name)
    */
    #endregion

    private void RunScript(ref object a)
    {
        List<string> fontList = new List<string>();

        InstalledFontCollection installedFontCollection = new InstalledFontCollection();

        FontFamily[] fontFamilies = installedFontCollection.Families;

        foreach(FontFamily font in fontFamilies)
        {
        if(!String.IsNullOrEmpty(font.Name)){
            fontList.Add(font.Name);
        }
        else{}
        }

        a = fontList;
    }
}
# ---------- end c_script_5 ----------
line_5 = LineSDL(Start=midpt, Direction=expr("-x", deplane.ZAxis), Length=len)
deplane_6 = DeconstructPlane(Plane=rot3d_2.Geometry)  # -> Origin, XAxis, YAxis, ZAxis
deplane_7 = DeconstructPlane(Plane=rot3d_2.Geometry)  # -> Origin, XAxis, YAxis, ZAxis
series_3 = Series(Start=0, Step=Slider(200, range=0..1000), Count=lng_3)
pt_3 = ConstructPoint(XCoordinate=series_3, YCoordinate=Slider(416, range=0..1000), ZCoordinate=0)
xy_4 = XYPlane(Origin=pt_3)
concat_3 = Concatenate(FragmentA="Y", FragmentB=item_5.Item, FragmentC="-", FragmentD=item_5.Item1)
series_4 = Series(Start=0, Step=Slider(200, range=0..1000), Count=lng_4)
pt_4 = ConstructPoint(XCoordinate=series_4, YCoordinate=Slider(416, range=0..1000), ZCoordinate=0)
xy_5 = XYPlane(Origin=pt_4)
item_7 = ListItem(List=c_script_5.a, Index=Slider(16, range=0..1000), Wrap=True)
concat_4 = Concatenate(FragmentA="Y", FragmentB=item_6.Item, FragmentC="-", FragmentD=item_6.Item1)
pipe_5 = Pipe(Curve=line_5, Radius=expr("x/2", material_thickness), Caps=1, FitRail=False)
pshift_11 = ShiftPaths(Data=pipe_5, Offset=-1)
sec_7 = BrepPlane(Brep=pshift_11, Plane=c_script_2.a)  # -> Curves, Points
pshift_12 = ShiftPaths(Data=sec_7.Curves, Offset=-1)
rdiff_5 = RegionDifference(CurvesA=graft_4, CurvesB=pshift_12)
area_5 = Area(Geometry=rdiff_5)  # -> Area, Centroid
pl_5 = ConstructPlane(Origin=area_5.Centroid, XAxis=deplane_6.ZAxis, YAxis=deplane_6.XAxis)
pshift_13 = ShiftPaths(Data=pipe, Offset=-1)
sec_8 = BrepPlane(Brep=pshift_13, Plane=c_script_2.a)  # -> Curves, Points
pshift_14 = ShiftPaths(Data=sec_8.Curves, Offset=-1)
rdiff_6 = RegionDifference(CurvesA=graft_4, CurvesB=pshift_14)
area_6 = Area(Geometry=rdiff_6)  # -> Area, Centroid
pl_6 = ConstructPlane(Origin=area_6.Centroid, XAxis=deplane_7.ZAxis, YAxis=deplane_7.XAxis)
panel = Panel(item_7)
tstat_7 = TreeStatistics(Tree=pshift_12)  # -> Paths, Length, Count
tstat_8 = TreeStatistics(Tree=pshift_14)  # -> Paths, Length, Count
lng_5 = ListLength(List=tstat_7.Paths)
dpath_5 = DeconstructPath(Branch=tstat_7.Paths)
lng_6 = ListLength(List=tstat_8.Paths)
dpath_6 = DeconstructPath(Branch=tstat_8.Paths)
c_script_6 = CSharpScript(
    textLine=concat_3,
    frame=graft(xy_4),
    fontName="SLF_RHN Architect",
    textHeight=Slider(7, range=0..100),
    spacing=Slider(0, range=0..100),
    horizontalAlignment=Slider(2, range=1..3),
    verticalAlignment=Slider(2, range=1..3),
    bold=Toggle(False),
    singleStrokeFont=Toggle(False))  # -> out, a, b; inputs textLine: String, frame: Plane, fontName: String, textHeight: Double, spacing: Double, horizontalAlignment: Int32, verticalAlignment: Int32, bold: Boolean, singleStrokeFont: Boolean; same code as c_script_3
item_8 = ListItem(List=dpath_5, Index=0, Wrap=True)  # -> Item, Item1
c_script_7 = CSharpScript(
    textLine=concat_4,
    frame=graft(xy_5),
    fontName="SLF_RHN Architect",
    textHeight=Slider(7, range=0..100),
    spacing=Slider(0, range=0..100),
    horizontalAlignment=Slider(2, range=1..3),
    verticalAlignment=Slider(2, range=1..3),
    bold=Toggle(False),
    singleStrokeFont=Toggle(False))  # -> out, a, b; inputs textLine: String, frame: Plane, fontName: String, textHeight: Double, spacing: Double, horizontalAlignment: Int32, verticalAlignment: Int32, bold: Boolean, singleStrokeFont: Boolean; same code as c_script_3
tag_3 = TextTag3D(
    Location=pl_3,
    Text=concat_3,
    Size=Slider(9, range=0..100),
    Colour=ColourSwatch(SwatchColor=RGB(0, 255, 51)),
    Justification=7)
item_9 = ListItem(List=dpath_6, Index=0, Wrap=True)  # -> Item, Item1
tag_4 = TextTag3D(
    Location=pl_4,
    Text=concat_4,
    Size=Slider(9, range=0..100),
    Colour=ColourSwatch(SwatchColor=RGB(0, 255, 51)),
    Justification=7)
orient_3 = Orient(Geometry=rdiff_3, Source=pl_3, Target=graft(xy_4))  # -> Geometry, Transform
orient_4 = Orient(Geometry=rdiff_4, Source=pl_4, Target=graft(xy_5))  # -> Geometry, Transform
concat_5 = Concatenate(FragmentA="Y", FragmentB=item_8.Item, FragmentC="-", FragmentD=item_8.Item1)
series_5 = Series(Start=0, Step=Slider(200, range=0..1000), Count=lng_5)
pt_5 = ConstructPoint(XCoordinate=series_5, YCoordinate=Slider(416, range=0..1000), ZCoordinate=0)
xy_6 = XYPlane(Origin=pt_5)
concat_6 = Concatenate(FragmentA="Y", FragmentB=item_9.Item, FragmentC="-", FragmentD=item_9.Item1)
series_6 = Series(Start=0, Step=Slider(200, range=0..1000), Count=lng_6)
pt_6 = ConstructPoint(XCoordinate=series_6, YCoordinate=Slider(416, range=0..1000), ZCoordinate=0)
xy_7 = XYPlane(Origin=pt_6)
tstat_9 = TreeStatistics(Tree=c_script_6.b)  # -> Paths, Length, Count
replace_3 = ReplacePaths(Data=c_script_6.b, Search=tstat_9.Paths, Replace=tstat_3.Paths)
group_3 = Group(Geometry=replace_3)
c_script_8 = CSharpScript(
    textLine=concat_5,
    frame=graft(xy_6),
    fontName="SLF_RHN Architect",
    textHeight=Slider(7, range=0..100),
    spacing=Slider(0, range=0..100),
    horizontalAlignment=Slider(2, range=1..3),
    verticalAlignment=Slider(2, range=1..3),
    bold=Toggle(False),
    singleStrokeFont=Toggle(False))  # -> out, a, b; inputs textLine: String, frame: Plane, fontName: String, textHeight: Double, spacing: Double, horizontalAlignment: Int32, verticalAlignment: Int32, bold: Boolean, singleStrokeFont: Boolean; same code as c_script_3
tag_5 = TextTag3D(
    Location=pl_5,
    Text=concat_5,
    Size=Slider(9, range=0..100),
    Colour=ColourSwatch(SwatchColor=RGB(0, 255, 51)),
    Justification=7)
c_script_9 = CSharpScript(
    textLine=concat_6,
    frame=graft(xy_7),
    fontName="SLF_RHN Architect",
    textHeight=Slider(7, range=0..100),
    spacing=Slider(0, range=0..100),
    horizontalAlignment=Slider(2, range=1..3),
    verticalAlignment=Slider(2, range=1..3),
    bold=Toggle(False),
    singleStrokeFont=Toggle(False))  # -> out, a, b; inputs textLine: String, frame: Plane, fontName: String, textHeight: Double, spacing: Double, horizontalAlignment: Int32, verticalAlignment: Int32, bold: Boolean, singleStrokeFont: Boolean; same code as c_script_3
tag_6 = TextTag3D(
    Location=pl_6,
    Text=concat_6,
    Size=Slider(9, range=0..100),
    Colour=ColourSwatch(SwatchColor=RGB(0, 255, 51)),
    Justification=7)
orient_5 = Orient(Geometry=rdiff_5, Source=pl_5, Target=graft(xy_6))  # -> Geometry, Transform
orient_6 = Orient(Geometry=rdiff_6, Source=pl_6, Target=graft(xy_7))  # -> Geometry, Transform
tstat_10 = TreeStatistics(Tree=c_script_8.b)  # -> Paths, Length, Count
replace_4 = ReplacePaths(Data=c_script_8.b, Search=tstat_10.Paths, Replace=tstat_7.Paths)
group_4 = Group(Geometry=replace_4)
tstat_11 = TreeStatistics(Tree=c_script_9.b)  # -> Paths, Length, Count
replace_5 = ReplacePaths(Data=c_script_9.b, Search=tstat_11.Paths, Replace=tstat_8.Paths)
group_5 = Group(Geometry=replace_5)
tstat_12 = TreeStatistics(Tree=c_script_7.b)  # -> Paths, Length, Count
replace_6 = ReplacePaths(Data=c_script_7.b, Search=tstat_12.Paths, Replace=tstat_4.Paths)
group_6 = Group(Geometry=replace_6)
